# Grasshopper definition mesh-table-20210718.gh (Grasshopper 1.0.7)
# plug-ins: LunchBox, Human

panel = Panel("""设计要求：
尺寸变化区间：高不变730。
长：500-2200，宽500-1000.800以内用小板，以上用大板1.5米宽。
标准尺寸：1800x800 要求和腿部比例最好看
结构强度要求中等-餐桌标准、会议桌、偶尔工作用桌子。
（工作桌：稳定性高，用于长期办公  操作桌：稳定性极高 用于厨房、台面加工、制作产品、站人。以后再开发）

目前任务：
选择1-2款最合理的椅子腿，确定一个基本结构方向，打样试验结构强度。
思路1：按照2200最大尺寸测试强度和腿部结构，做到最细腿。
2：桌面可选 0.8/1.3+铝蜂窝350一张/pvc或加厚铁板增加横档，反正以平整度和性价比为第一。
3：腿部可考虑型材。
4：不同类型的桌子 写不同的程序，不要混一起。
直脚桌、斜脚桌、独脚桌、框架桌、办公桌、操作桌、创意桌、几桌、餐厅桌。""")
# 思路：
# 先做框架，再做腿，再做面板。
_1_length = Slider(2200, range=500..3000)
_2_wide = Slider(1000, range=500..3000)
pt = Point(<point referenced from the Rhino model>)
tag = TextTag3D(Location=pt, Text=panel, Size=Slider(148, range=50..200), Colour=ColourSwatch(SwatchColor=RGB(0, 0, 0)), Justification=7)
division = Division(A=_2_wide, B=2)
division_2 = Division(A=_1_length, B=2)
neg = Negative(Value=division)
neg_2 = Negative(Value=division_2)
dom = ConstructDomain(DomainStart=division, DomainEnd=neg)
dom_2 = ConstructDomain(DomainStart=division_2, DomainEnd=neg_2)
_11_桌架边厚 = Slider(7.544, range=2..10)
_10_桌架结构厚度 = Slider(40.12, range=10..100)
rectangle = Rectangle(Plane=PlaneXY(0, 0, 0), XSize=dom_2, YSize=dom, Radius=0)  # -> Rectangle, Length
_45 = Integer(45)
cp = ControlPoints(Curve=rectangle.Rectangle)  # -> Points, Weights, Knots
addition = Addition(A=_45, B=90)
neg_3 = Negative(Value=_45)
neg_4 = Negative(Value=addition)
_270 = Integer(270)
_90 = Integer(90)
shift = ShiftList(List=cp.Points, Shift=1, Wrap=False)
neg_5 = Negative(Value=_10_桌架结构厚度)
merge = Merge(Data1=addition, Data2=neg_4, Data3=neg_3, Data4=_45)
neg_6 = Negative(Value=_11_桌架边厚)
_3_腿宽度mm = Slider(15, range=10..200)
pt_2 = ConstructPoint(XCoordinate=0, YCoordinate=0, ZCoordinate=neg_5)
pt_3 = ConstructPoint(XCoordinate=0, YCoordinate=0, ZCoordinate=neg_6)
X = UnitX(Factor=shift)
Z = UnitZ(Factor=1)
rad = Radians(Degrees=merge)
addition_2 = Addition(A=_270, B=180)
neg_7 = Negative(Value=_270)
neg_8 = Negative(Value=addition_2)
addition_3 = Addition(A=_90, B=180)
neg_9 = Negative(Value=_90)
neg_10 = Negative(Value=addition_3)
xy = XYPlane(Origin=pt_2)
xy_2 = XYPlane(Origin=pt_3)
vrot = Rotate(Vector=X, Axis=Z, Angle=rad)
merge_2 = Merge(Data1=addition_2, Data2=neg_8, Data3=neg_7, Data4=_270)
merge_3 = Merge(Data1=addition_3, Data2=neg_10, Data3=neg_9, Data4=_90)
division_3 = Division(A=_3_腿宽度mm, B=2)
line = LineSDL(Start=shift, Direction=vrot, Length=division_3)  # -> flatten(Line)
rad_2 = Radians(Degrees=merge_2)
rad_3 = Radians(Degrees=merge_3)
_4_腿高度mm = Slider(740, range=10..1000)
_5_腿脚最小宽度 = Slider(4, range=4..10)
_6_脚尖度 = Slider(0, range=0..1)
neg_11 = Negative(Value=_4_腿高度mm)
end = EndPoints(Curve=line)  # -> Start, End
Z_2 = UnitZ(Factor=neg_11)
pt_4 = Point(end.End)
rotate = Rotate(Geometry=line, Angle=rad_3, Plane=pt_4)  # -> Geometry, Transform
rotate_2 = Rotate(Geometry=line, Angle=rad_2, Plane=pt_4)  # -> Geometry, Transform
end_2 = EndPoints(Curve=rotate_2.Geometry)  # -> Start, End
end_3 = EndPoints(Curve=rotate.Geometry)  # -> Start, End
pt_5 = Point(end_2.Start)
pt_6 = Point(end_3.Start)
pt_7 = Point([pt_6, pt_5])
ln = Line(StartPoint=pt_6, EndPoint=pt_5)
move = Move(Geometry=ln, Motion=Z_2)  # -> Geometry, Transform
crv = Curve(move.Geometry)
len = Length(Curve=crv)
subtraction = Subtraction(A=len, B=_5_腿脚最小宽度)
division_4 = Division(A=subtraction, B=2)
dom_3 = ConstructDomain(DomainStart=0, DomainEnd=division_4)
remap = RemapNumbers(Value=_6_脚尖度, Source=Domain(0, 1), Target=dom_3)  # -> Mapped, Clipped
neg_12 = Negative(Value=remap.Mapped)
line_2 = Line(ln)
ext = ExtendCurve(Curve=crv, Type=0, Start=neg_12, End=neg_12)  # -> graft(Curve)
line_3 = Line(graft(line_2))
end_4 = EndPoints(Curve=ext)  # -> Start, End
end_5 = EndPoints(Curve=line_3)  # -> Start, End
ln_2 = Line(StartPoint=end_5.End, EndPoint=end_4.End)
line_4 = Line(flatten(ln_2))
ln_3 = Line(StartPoint=end_5.Start, EndPoint=end_4.Start)
line_5 = Line(flatten(ln_3))
merge_4 = Merge(Data1=line_5, Data2=line_4)
pcx = CurvePlane(Curve=merge_4, Plane=xy_2)  # -> flatten(Points), ParamsC, ParamsP
pt_8 = Point(flatten(pcx.Points))
_8_腿_下深 = Slider(0.297, range=0..1)
loft = Loft(Curves=[ln_3, ln_2], Options={Adjust=False, Closed=False, LoftEnds=0, LoftSimp=0, LoftType=0, Rebuild=10, Refit=0.01})
_8 = Slider(0.542, range=0..1)
_7_腿_上深 = Slider(85.96, range=4..200)
pt_9 = Point(end_5.End)
pt_10 = Point(end_5.Start)
dom_4 = ConstructDomain(DomainStart=4, DomainEnd=_7_腿_上深)
merge_5 = Merge(Data1=end_4.Start, Data2=end_4.End)
remap_2 = RemapNumbers(Value=_8_腿_下深, Source=Domain(0, 1), Target=dom_4)  # -> Mapped, Clipped
range = Range(Domain=Domain(0, 1), Steps=10)
merge_6 = Merge(Data1=pt_10, Data2=pt_9)
panel_2 = Panel(remap_2.Mapped)
line_6 = LineSDL(Start=merge_6, Direction=graft(vrot), Length=_7_腿_上深)
line_7 = LineSDL(Start=merge_5, Direction=graft(vrot), Length=remap_2.Mapped)
end_6 = EndPoints(Curve=line_7)  # -> Start, End
rulesrf = RuledSurface(CurveA=line_6, CurveB=line_7)
end_7 = EndPoints(Curve=line_6)  # -> Start, End
pt_11 = Point(end_6.End)
pt_12 = Point(pt_11)
pt_13 = Point(end_7.End)
pt_14 = Point(pt_13)
ln_4 = Line(StartPoint=pt_14, EndPoint=pt_12)  # -> flatten(Line)
item = ListItem(List=ln_4, Index=[5, 7], Wrap=True)
item_2 = ListItem(List=ln_4, Index=[2, 4], Wrap=True)
item_3 = ListItem(List=ln_4, Index=[1, 3], Wrap=True)
item_4 = ListItem(List=ln_4, Index=[0, 6], Wrap=True)
flip = FlipMatrix(Data=pt_11)
flip_2 = FlipMatrix(Data=pt_13)
bang = ExplodeTree(Data=flip)  # -> _0000, _0001
bang_2 = ExplodeTree(Data=flip_2)  # -> _0000, _0001
_9_腿_肚子深 = Slider(189.23, range=0..190)
ln_5 = Line(StartPoint=bang._0000, EndPoint=bang._0001)
ln_6 = Line(StartPoint=bang_2._0000, EndPoint=bang_2._0001)
pt_15 = Point(pt_13)
midpt = CurveMiddle(Curve=ln_5)  # -> flatten(Midpoint)
len_2 = Length(Curve=ln_5)
midpt_2 = CurveMiddle(Curve=ln_6)  # -> flatten(Midpoint)
line_8 = LineSDL(Start=midpt_2, Direction=vrot, Length=_9_腿_肚子深)
division_5 = Division(A=len_2, B=2)
end_8 = EndPoints(Curve=line_8)  # -> Start, End
pt_16 = Point(pt_11)
pt_17 = Point(pt_13)
pt_18 = Point(end_8.Start)
pt_19 = Point(end_8.End)
pt_20 = Point(pt_19)
pline = PolyLine(Vertices=pt_20, Closed=True)  # -> flatten(Polyline)
flip_3 = FlipCurve(Curve=pline)  # -> Curve, Flag
pt_21 = Point(graft(pt_19))
item_5 = ListItem(List=pt_15, Index=0, Wrap=True)  # -> flatten(Item)
vec2pt = Vector2Pt(PointA=item_5, PointB=pt_19, Unitize=False)  # -> Vector, Length
vec2pt_2 = Vector2Pt(PointA=item_5, PointB=pt_18, Unitize=False)  # -> Vector, Length
ln_7 = Line(StartPoint=pt_21, EndPoint=pt_17)  # -> simplify(Line)
angle = Angle(VectorA=vec2pt_2.Vector, VectorB=vec2pt.Vector)  # -> Angle, Reflex
join = JoinCurves(Curves=ln_7, Preserve=False)
tan = Tangent(Value=angle.Angle)
multiplication = Multiplication(A=tan, B=division_5)
line_9 = LineSDL(Start=midpt, Direction=vrot, Length=multiplication)
end_9 = EndPoints(Curve=line_9)  # -> Start, End
pt_22 = Point(end_9.End)
ln_8 = Line(StartPoint=pt_19, EndPoint=pt_22)
crv_2 = Curve(ln_8)
pcx_2 = CurvePlane(Curve=crv_2, Plane=xy)  # -> Points, ParamsC, ParamsP
pt_23 = Point(flatten(pcx_2.Points))
merge_7 = Merge(Data1=pt_7, Data2=pt_8, Data3=pt_23)
points = PointList(Points=merge_7, Size=Slider(12.262, range=0..100))
item_6 = ListItem(List=merge_7, Index=[19, 15, 14, 18], Wrap=True)
item_7 = ListItem(List=merge_7, Index=[18, 10, 9, 17], Wrap=True)
item_8 = ListItem(List=merge_7, Index=[17, 13, 12, 16], Wrap=True)
item_9 = ListItem(List=merge_7, Index=[16, 8, 11, 19], Wrap=True)
item_10 = ListItem(List=merge_7, Index=[16, 19, 18, 17], Wrap=True)
item_11 = ListItem(List=merge_7, Index=[3, 11, 8, 0], Wrap=True)
item_12 = ListItem(List=merge_7, Index=[6, 14, 15, 7], Wrap=True)
item_13 = ListItem(List=merge_7, Index=[4, 12, 13, 5], Wrap=True)
item_14 = ListItem(List=merge_7, Index=[1, 9, 10, 2], Wrap=True)
item_15 = ListItem(List=merge_7, Index=[1, 5, 4, 0, 3, 7, 6, 2], Wrap=True)
plfit = PlaneFit(Points=item_9)  # -> Plane, Deviation
pline_2 = PolyLine(Vertices=item_13, Closed=True)
pline_3 = PolyLine(Vertices=item_10, Closed=True)
pline_4 = PolyLine(Vertices=item_11, Closed=True)
pline_5 = PolyLine(Vertices=item_12, Closed=True)
pline_6 = PolyLine(Vertices=item_14, Closed=True)
pline_7 = PolyLine(Vertices=item_15, Closed=True)
plfit_2 = PlaneFit(Points=item_7)  # -> Plane, Deviation
plfit_3 = PlaneFit(Points=item_8)  # -> Plane, Deviation
plfit_4 = PlaneFit(Points=item_6)  # -> Plane, Deviation
pcx_3 = CurvePlane(Curve=item, Plane=plfit_4.Plane)  # -> flatten(Points), ParamsC, ParamsP
pcx_4 = CurvePlane(Curve=item_2, Plane=plfit_2.Plane)  # -> flatten(Points), ParamsC, ParamsP
pcx_5 = CurvePlane(Curve=item_3, Plane=plfit_3.Plane)  # -> flatten(Points), ParamsC, ParamsP
pcx_6 = CurvePlane(Curve=item_4, Plane=plfit.Plane)  # -> flatten(Points), ParamsC, ParamsP
boundary = BoundarySurfaces(Edges=[pline_2, pline_4, pline_5, pline_6, pline_7])
loft_2 = Loft(
    Curves=[flip_3.Curve, pline_3],
    Options={Adjust=False, Closed=False, LoftEnds=0, LoftSimp=0, LoftType=0, Rebuild=10, Refit=0.01})
ins = InsertItems(List=item_6, Item=pcx_3.Points, Indices=[3, 1], Wrap=True)
ins_2 = InsertItems(List=item_9, Item=pcx_6.Points, Indices=[1, 3], Wrap=True)
ins_3 = InsertItems(List=item_7, Item=pcx_4.Points, Indices=[3, 1], Wrap=True)
ins_4 = InsertItems(List=item_8, Item=pcx_5.Points, Indices=[3, 1], Wrap=True)
pline_8 = PolyLine(Vertices=ins_2, Closed=True)
pline_9 = PolyLine(Vertices=ins, Closed=True)
pline_10 = PolyLine(Vertices=ins_3, Closed=True)
pline_11 = PolyLine(Vertices=ins_4, Closed=True)
boundary_2 = BoundarySurfaces(Edges=pline_8)
boundary_3 = BoundarySurfaces(Edges=pline_9)
boundary_4 = BoundarySurfaces(Edges=pline_10)
boundary_5 = BoundarySurfaces(Edges=pline_11)
merge_8 = Merge(Data1=boundary_2, Data2=boundary_3, Data3=boundary_4, Data4=boundary_5, Data5=loft_2, Data6=boundary)
ln_9 = Line(StartPoint=graft(pt_22), EndPoint=pt_16)  # -> simplify(Line)
join_2 = JoinCurves(Curves=ln_9, Preserve=False)
merge_9 = Merge(Data1=join, Data2=join_2)
loft_3 = Loft(Curves=merge_9, Options={Adjust=False, Closed=False, LoftEnds=0, LoftSimp=0, LoftType=0, Rebuild=10, Refit=0.01})
merge_10 = Merge(Data1=loft, Data2=rulesrf, Data3=loft_3)
merge_11 = Merge(Data1=merge_10, Data2=merge_8)  # -> flatten(Result)
createatts = CreateAttributes(enableFullPath=False)
join_3 = BrepJoin(Breps=merge_11)  # -> Breps, Closed
panel_3 = Panel(merge_11)
bake = BakeGeometry(Bake=Button(), Geometry=join_3.Breps, DeleteOldBakes=False, PreserveTrees=False)
bake_2 = ObjectBake(BakeToggle=False, Layer="GH_Bake", ObjectName="GH_Obj", ObjectColor=RGB(255, 255, 255), LayerColor=RGB(255, 255, 255))
material = CreateMaterial(
    Diffuse=ColourSwatch(SwatchColor=RGB(250, 30, 30)),
    Specular=RGB(255, 255, 255),
    Emission=RGB(0, 0, 0),
    Transparency=0,
    Shine=0)
preview = CustomPreview(Geometry=merge_11, Material=material)
